# Grasshopper definition DeltaSlicer.gh (Grasshopper 0.9.76)

tristedflower = Brep(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)
flowertriangle = Brep(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)
curvedwall = Brep(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)

twisted = Brep(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)
angled = Brep(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)
nicevase = Brep(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)
pyramid = Brep(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)
cylinder = Brep(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)
wavewall = Brep(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)
wavierwall = Brep(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)
ellipse = Brep(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)
littrenicevase = Brep(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)

layerheight = Slider(1.06, range=0.5..2)
model = Brep(pyramid)
angle = Slider(90, range=0..180)
scale = Slider(3, range=1..10)
rotationangle = Slider(1.25, range=0..10)
zigzag = BooleanToggle(True)
cross = BooleanToggle(False)
zoffset = Number(0)
addholes = BooleanToggle(False)
vertical = BooleanToggle(False)
feedrate = Slider(100, range=10..150)
layeroffset = Number(5)
ppl = Slider(22, range=2..100)

createplanes = CSharpScript(layerHeight=layerheight, brep=model)  # -> out, A; inputs layerHeight: Double, brep: Brep
# ---------- createplanes: C# ----------
    Vector3d Vx = new Vector3d(1, 0, 0);
    Vector3d Vy = new Vector3d(0, 1, 0);
    Vector3d Vz = new Vector3d(0, 0, 1);

    BoundingBox box = brep.GetBoundingBox(true);

    double max = box.Corner(false, false, false).Z;
    Print(max.ToString());

    int layers = (int) Math.Floor(max / layerHeight);
    
    if( max % layerHeight <= 0.5)
    {
      layers--; 
    }

    Plane[] result = new Plane[layers + 1];

    for (int i = 0; i <= layers; i++)
    {
      Point3d origin = new Point3d(0, 0, i * layerHeight);

      Plane plan = new Plane(origin, Vz);
      Print("hello" + i.ToString());
      result[i] = plan;
    }
    A = result;
# ---------- end createplanes ----------
getintersections = CSharpScript(planes=createplanes.A, brep=model, RotationAngle=rotationangle)  # -> out, A; inputs planes: list of Plane, brep: Brep, RotationAngle: Double
# ---------- getintersections: C# ----------
    Curve[] list = new Curve[planes.Count()];

    Vector3d vec = new Vector3d(0, 0, 1);
    Point3d center = new Point3d(0, 0, 0);

    for(int i = 0; i < planes.Count(); i++)
    {
      brep.Rotate(RotationAngle/180*3.141592, vec, center);
      Point3d[] pts;
      Curve[] c = new Curve[1];
      Rhino.Geometry.Intersect.Intersection.BrepPlane(brep, planes[i], 1, out c, out pts);
      list[i] = c[0];
    }
    A = list;
# ---------- end getintersections ----------
generatepoints = CSharpScript(
    Intersections=getintersections.A,
    PointsPerLayers=ppl,
    Angle=angle,
    Scale=scale,
    zigzag=zigzag,
    cross=cross,
    zoffset=zoffset,
    addHoles=addholes,
    vertZigzag=vertical)  # -> out, A; inputs Intersections: list of Curve, PointsPerLayers: Int32, Angle: Double, Scale: Double, zigzag: Boolean, cross: Boolean, zoffset: Double, addHoles: Boolean, vertZigzag: Boolean
# ---------- generatepoints: C# ----------
    Point3d[][] result = new Point3d[Intersections.Count()][];

    for(int i = 0; i < Intersections.Count() ; i++)
    {
      Intersections[i].DivideByCount(PointsPerLayers, true, out result[i]);
      Print(result[i].Count().ToString());

    }
    Curve Fcurve = Intersections[1];
    if(!Fcurve.IsClosed)
    {
      for(int i = 0; i < result.Length; i++)
      {
        if(i % 2 == 1)
        {
          Array.Reverse(result[i]);
        }
      }
    }

    Point3d[,] returnValue = ChangeFormat(result);

    returnValue = ChangeZ(returnValue, zoffset);

    if(zigzag)
    {
      if(cross)
      {
        returnValue = GenerateCrossZigZag(returnValue, Angle, Scale);
      }
      else
      {
        returnValue = GenerateZigZag(returnValue, Angle, Scale);
      }
    }
    if(vertZigzag){
      returnValue = GenerateVertZigZag(returnValue);
    }

    if(addHoles){
      returnValue = RemovePoints(returnValue);
    }

    A = returnValue;
# ---------- generatepoints: C# additional code ----------
  private Point3d[,] ChangeZ(Point3d[,] pTable, double zoffset)
  {
    int layers = pTable.GetLength(0);
    int PPL = pTable.GetLength(1);
    Point3d[,] result = (Point3d[,]) pTable.Clone();


    for(int i = 0; i < layers; i++)
    {
      for(int j = 0; j < PPL; j++)
      {
        Point3d p = (result[i, j]);
        result[i, j] = new Point3d(p.X, p.Y, p.Z + zoffset);
      }
    }
    return result;
  }

  private Point3d[,] GenerateCrossZigZag(Point3d[,] pTable, double angle, double scale)
  {
    int layers = pTable.GetLength(0);
    int PPL = pTable.GetLength(1);
    Point3d[,] result = (Point3d[,]) pTable.Clone();

    for(int i = 0; i < layers; i++)
    {
      for(int j = 0; j < PPL; j++)
      {
        if(i % 2 == 0)
        {

          if(j < PPL - 1)
          {
            if(j % 2 == 0)
            {
              Vector3d rVec = vectorCalculation(pTable[i, j], pTable[i, j + 1], angle, scale);
              result[i, j] = new Point3d(rVec);
            }
            else
            {
              Vector3d rVec = vectorCalculation(pTable[i, j], pTable[i, j + 1], angle, -scale);
              result[i, j] = new Point3d(rVec);
            }
          }
          else
          {
            Vector3d rVec = vectorCalculation(pTable[i, j], pTable[i, 1], angle, scale);
            result[i, j] = new Point3d(rVec);
          }
        }

        else

        {
          if(j < PPL - 1)
          {
            if(j % 2 == 0)
            {
              Vector3d rVec = vectorCalculation(pTable[i, j], pTable[i, j + 1], angle, -scale);
              result[i, j] = new Point3d(rVec);
            }
            else
            {
              Vector3d rVec = vectorCalculation(pTable[i, j], pTable[i, j + 1], angle, scale);
              result[i, j] = new Point3d(rVec);
            }
          }
          else
          {
            Vector3d rVec = vectorCalculation(pTable[i, j], pTable[i, 1], angle, -scale);
            result[i, j] = new Point3d(rVec);
          }
        }

      }
    }

    return result;
  }

  private Point3d[,] GenerateZigZag(Point3d[,] pTable, double angle, double scale)
  {
    int layers = pTable.GetLength(0);
    int PPL = pTable.GetLength(1);
    Point3d[,] result = (Point3d[,]) pTable.Clone();

    for(int i = 0; i < layers; i++)
    {
      for(int j = 0; j < PPL; j++)
      {
        if(j < PPL - 1)
        {
          if(j % 2 == 0)
          {
            Vector3d rVec = vectorCalculation(pTable[i, j], pTable[i, j + 1], angle, scale);
            result[i, j] = new Point3d(rVec);
          }
          else
          {
            Vector3d rVec = vectorCalculation(pTable[i, j], pTable[i, j + 1], angle, -scale);
            result[i, j] = new Point3d(rVec);
          }
        }
        else
        {
          Vector3d rVec = vectorCalculation(pTable[i, j], pTable[i, 1], angle, -scale);
          result[i, j] = new Point3d(rVec);
        }
      }
    }
    return result;
  }

  private Point3d[,] GenerateVertZigZag(Point3d[,] pTable)
  {
    int layers = pTable.GetLength(0);
    int PPL = pTable.GetLength(1);
    Point3d[,] result = new Point3d[layers, PPL];

    for(int i = 0; i < layers; i = i + 2)
    {

      Point3d[] temp = new Point3d[2 * PPL];

      for(int j = 0; j < PPL; j = j + 2)
      {
        if(i < layers - 1){
          if(j < PPL - 1)
          {
            result[i, j] = pTable[i, j / 2];

            result[i, j + 1] = pTable[i + 1, j / 2];

            result[i + 1, j] = pTable[i, ((j + PPL) / 2)];

            result[i + 1, j + 1] = pTable[i + 1, ((j + PPL) / 2)];
          }
          else
          {
            result[i, j] = pTable[i, j / 2];

            result[i + 1, j] = pTable[i, ((j + PPL) / 2)];
          }
        }
      }
    }
    return result;
  }

  private Point3d[,] RemovePoints(Point3d[,] pTable)
  {
    int layers = pTable.GetLength(0);
    int PPL = pTable.GetLength(1);
    int temp = 4;

    for(int l = 0; l < layers - 5; l++)
    {
      if(l % 5 == 0)
      {
        temp = (temp + 4) % PPL;
        for(int i = 0; i < 5; i++)
        {
          if(true)
          {
            pTable[l + i, temp] = pTable[l + i, temp + 1];
          }
        }
      }
    }

    return pTable;
  }

  private T[,] TransposeRowsAndColumns<T>(T[,] arr)
  {
    int rowCount = arr.GetLength(0);
    int columnCount = arr.GetLength(1);
    T[,] transposed = new T[columnCount, rowCount];
    if (rowCount == columnCount)
    {
      transposed = (T[,]) arr.Clone();
      for (int i = 1; i < rowCount; i++)
      {
        for (int j = 0; j < i; j++)
        {
          T temp = transposed[i, j];
          transposed[i, j] = transposed[j, i];
          transposed[j, i] = temp;
        }
      }
    }
    else
    {
      for (int column = 0; column < columnCount; column++)
      {
        for (int row = 0; row < rowCount; row++)
        {
          transposed[column, row] = arr[row, column];
        }
      }
    }
    return transposed;
  }

  private T[,] ChangeFormat<T>(T[][] source)
  {
    try
    {
      int FirstDim = source.Length;
      int SecondDim = source.GroupBy(row => row.Length).Single().Key; // throws InvalidOperationException if source is not rectangular

      var result = new T[FirstDim, SecondDim];
      for (int i = 0; i < FirstDim; ++i)
        for (int j = 0; j < SecondDim; ++j)
          result[i, j] = source[i][j];

      return (result);
    }
    catch (InvalidOperationException)
    {
      throw new InvalidOperationException("The given jagged array is not rectangular.");
    }
  }

  private Vector3d vectorCalculation(Point3d p1, Point3d p2, double angle, double scale){

    //create vectors
    Vector3d vec = Vector3d.Subtract(new Vector3d(p2), new Vector3d(p1));
    vec.Unitize();
    vec = Vector3d.Multiply(vec, scale);

    Vector3d vecZ = new Vector3d(0, 0, 1);

    //vector rotation
    vec.Rotate((Math.PI / 180) * angle, vecZ);
    //add vector to point_01

    Vector3d rVec = Vector3d.Add(new Vector3d(p1), vec);
    Print(rVec.ToString());
    return rVec;

  }
# ---------- end generatepoints ----------
createtreepath = CSharpScript(x=generatepoints.A)  # -> out, flatten(Tree); inputs x: list of Point3d
# ---------- createtreepath: C# ----------
    DataTree<Point3d> srfPointsTable = new DataTree<Point3d>();


      for(int i = 0; i < x.Count(); i++)
      {
        Print(i.ToString());
        GH_Path pth = new GH_Path(i);
        srfPointsTable.Add(x[i], pth);
      }

    Tree = srfPointsTable;
# ---------- end createtreepath ----------
pline = PolyLine(Vertices=createtreepath.Tree, Closed=False)
c_script = CSharpScript(Listofpoints=createtreepath.Tree, speed=feedrate, ppl=ppl, layerOffset=layeroffset)  # -> out, A; inputs Listofpoints: list of Point3d, speed: Double, ppl: Int32, layerOffset: Int32
# ---------- c_script: C# ----------
    List<double> feedrates = new List<double>();
    feedrates.Add(300);

    int NumOfPoints = Listofpoints.Count();
    int tempPpl = ppl;

    for(int i = 1; i < NumOfPoints; i++)
    {
      //      if( i % tempPpl == 0)
      //      {
      //        feedrates.Add(speed * 10);
      //        feedrates.Add(speed * 10);
      //        tempPpl = tempPpl + 5 * ppl + layerOffset;
      //        i++;
      //      }
      if(i % 5 == 0 && false)
      {
        feedrates.Add(speed / 8);
      }
      else
      {
        feedrates.Add(speed);
      }
    }
    A = feedrates;
# ---------- end c_script ----------
timecalculatorminute = TimeCalculatorMINUTE(C=pline, A=feedrate)
gcode = GCODE(P=createtreepath.Tree, f=c_script.A)
panel = Panel(gcode)
panel_2 = Panel(timecalculatorminute)

# ==== cluster GCODE
P = ClusterInput()
pdecon = Deconstruct(Point=P)  # -> XComponent, YComponent, ZComponent
f = ClusterInput()
expression = Expression(
    x=pdecon.XComponent,
    y=pdecon.YComponent,
    z=pdecon.ZComponent,
    f=f,
    Expression="Format(\"G1 X{0:0.000} Y{1:0.000} Z{2:0.000} F{3:0.000}\", x, y, z, f)")  # -> flatten(R)
footer = Text(["G92 E0", "G28 X  ; home X axis", "M84     ; disable motors"])
header = Text(["M107", "G28 ; home all axes", "G1 Z5 F5000 ; lift nozzle", "G21 ; set units to millimeters", "G90 ; use absolute coordinates", "M82 ; use absolute distances for extrusion", "G92 E0", "G1 Z4.000 F60.000", "G1 E-2.00000 F2400.00000", "G92 E0"])
merge = Merge(Data1=header, Data2=expression, Data3=footer)
R = ClusterOutput(merge)

# ==== cluster TimeCalculatorMINUTE
int = Integer(60)
A = ClusterInput()
division = Division(A=A, B=int)
C = ClusterInput()
len = Length(Curve=C)
division_2 = Division(A=len, B=division)
division_3 = Division(A=division_2, B=int)
R = ClusterOutput(division_3)
